# Grasshopper definition clusters.gh (Grasshopper 1.0.8)
# plug-ins: RhinoCodePluginGH

multiplier = Slider(0.75, range=0.5..3)
curve = Curve(<curve referenced from the Rhino model>)
expression = Expression(i=multiplier, Expression="1.6*i")
expression_2 = Expression(i=multiplier, Expression="2.1*i")
expression_3 = Expression(i=multiplier, Expression="0.6*i")
expression_4 = Expression(i=multiplier, Expression="0.8*i")
expression_5 = Expression(i=multiplier, Expression="0.4*i+0.2")
expression_6 = Expression(i=multiplier, Expression="4.8*i")
expression_7 = Expression(wx=expression_6, ry=expression, Expression="wx/2+ry")
rule_generation = RuleGeneration(
    curve=curve,
    alpha=Slider(83, range=0..360),
    beta=Slider(360, range=0..360),
    i=multiplier,
    curve_scale=Slider(1.5, range=0.5..3))  # -> rules, b_vec, points, t_vec
flatten = Flatten(rules=rule_generation.rules, space_curve=curve, i=multiplier)  # -> flattened_points, flattened_curve, space_ribbon
negative = Negative(Value=Slider(0.4, range=0..1))
unit_cut = UnitCut(i=multiplier, flattened_points=flatten.flattened_points, planar_curve=flatten.flattened_curve)
raw_unit = RawUnit(
    planar_curve=flatten.flattened_curve,
    points_curve=flatten.flattened_points,
    i=multiplier,
    loft_angle=Slider(15, range=0..100))
ribbon = Ribbon(planar_curve=flatten.flattened_curve, i=multiplier, width=expression_4, height=expression_5)
base_cut = BaseCut(
    i=multiplier,
    planar_curve=flatten.flattened_curve,
    flattened_points=flatten.flattened_points,
    base_cut_x=expression_2,
    base_cut_y=expression_3)
ribbon_2 = Ribbon(planar_curve=flatten.flattened_curve, i=multiplier, width=expression_7, height=negative)
simplify_tree = SimplifyTree(Tree=ribbon_2, Front=False)
unit_z = UnitZ(Factor=0.02)
solid_difference = SolidDifference(BrepsA=simplify_tree, BrepsB=base_cut)
unit_z_2 = UnitZ(Factor=Slider(0.02, range=0..0.1))
curve_closest_point = CurveClosestPoint(Point=rule_generation.points, Curve=curve)  # -> Point, Parameter, Distance
move = Move(Geometry=solid_difference, Motion=unit_z)  # -> Geometry, Transform
negative_2 = Negative(Value=unit_z_2)
curvature = Curvature(Curve=curve, Parameter=curve_closest_point.Parameter)  # -> Point, Curvature, Curvature_2
move_2 = Move(Geometry=ribbon, Motion=negative_2)  # -> Geometry, Transform
curve_closest_point_2 = CurveClosestPoint(Point=flatten.flattened_points, Curve=flatten.flattened_curve)  # -> Point, Parameter, Distance
featured_unit = FeaturedUnit(i=multiplier, unit=raw_unit, unit_cut=unit_cut, splint_cut=ribbon)
simplify_tree_2 = SimplifyTree(Tree=move.Geometry, Front=False)
vector_length = VectorLength(Vector=curvature.Curvature)
curvature_2 = Curvature(Curve=flatten.flattened_curve, Parameter=curve_closest_point_2.Parameter)  # -> Point, Curvature, Curvature_2
dispatch = Dispatch(List=vector_length, DispatchPattern=[True, False])  # -> ListA, ListB
simplify_tree_3 = SimplifyTree(Tree=move_2.Geometry, Front=False)
merge = Merge(Data1=simplify_tree_2, Data2=simplify_tree_3)
vector_length_2 = VectorLength(Vector=curvature_2.Curvature)
entwine = Entwine(Branch00=dispatch.ListA, Branch01=dispatch.ListB, FlattenInputs=True)
solid_union = SolidUnion(Breps=merge)
trim_tree = TrimTree(Tree=featured_unit, Depth=1)
expression_8 = Expression(x=entwine, Expression="If(abs(x)<0.05, x, 0)")
expression_9 = Expression(x=vector_length_2, Expression="If(x<0.05, x, 0)")
merge_2 = Merge(Data1=solid_union, Data2=trim_tree)
solid_union_2 = SolidUnion(Breps=merge_2)
python_3_script = Python3Script(x=expression_9, y=expression_8)  # -> out, a; inputs x: tree, y: tree
# ---------- python_3_script: Python ----------
import ghpythonlib.treehelpers as tr

x_in = tr.tree_to_list(x)
y_in = tr.tree_to_list(y)

for i in range(2):
    for j in range(len(x_in[i])):
        if x_in[i][j] == 0 or y_in[i][j] == 0:
            print(f"Invalid curvature for generation at side {i}, point {j}")
# ---------- end python_3_script ----------
expression_10 = Expression(x=expression_9, y=expression_8, Expression="1/If(abs(x)>abs(y), y, x)")
panel = Panel(python_3_script.out)
zipper_rearrange = Zipper_Rearrange(geo=solid_union_2)
geometry = Geometry(zipper_rearrange)

# ==== cluster RuleGeneration: Generate rule and points by input curve, angles, multiplier and curve scale
curve = ClusterInput()
beta = ClusterInput()
alpha = ClusterInput()
i = ClusterInput()
curve_scale = ClusterInput()
python_3_script = Python3Script(Curve=curve)  # -> out, a
#   port Curve: imported curve
# ---------- python_3_script: Python ----------
a=Curve
# ---------- end python_3_script ----------
python_3_script_2 = Python3Script(Beta=beta)  # -> out, a
# ---------- python_3_script_2: Python ----------
a=Beta
# ---------- end python_3_script_2 ----------
python_3_script_3 = Python3Script(Alpha=alpha)  # -> out, a
# ---------- python_3_script_3: Python ----------
a=Alpha
# ---------- end python_3_script_3 ----------
python_3_script_4 = Python3Script(i=i)  # -> out, a
# ---------- python_3_script_4: Python ----------
a=i
# ---------- end python_3_script_4 ----------
python_3_script_5 = Python3Script(Curve_Scale=curve_scale)  # -> out, a
# ---------- python_3_script_5: Python ----------
a=Curve_Scale
# ---------- end python_3_script_5 ----------
multiplier = Number(python_3_script_4.a)
scale = Scale(Geometry=python_3_script.a, Center=Point(0, 0, 0), Model_scale=python_3_script_5.a)  # -> Geometry, Transform
expression = Expression(i=multiplier, Expression="3.2*i")
divide_distance = DivideDistance(Curve=scale.Geometry, Distance=expression)  # -> Points, Tangents, Parameters
expression_2 = Expression(i=multiplier, Expression="1.6*i")
expression_3 = Expression(ry=expression_2, Expression="ry*2")
python_3_script_6 = Python3Script(x=divide_distance.Points)  # -> out, a; inputs x: list of Point3d
# ---------- python_3_script_6: Python ----------
import ghpythonlib.treehelpers as tr

out=[]

for i in range(len(x)-2):
    item=[]
    item.append(x[i])
    item.append(x[i+1])
    item.append(x[i+2])
    out.append(item)

a=tr.list_to_tree(out)
# ---------- end python_3_script_6 ----------
list_item = ListItem(List=python_3_script_6.a, Index=0, Wrap=True)
list_item_2 = ListItem(List=python_3_script_6.a, Index=1, Wrap=True)
list_item_3 = ListItem(List=python_3_script_6.a, Index=2, Wrap=True)
curvature = Curvature(Curve=scale.Geometry, Parameter=divide_distance.Parameters)  # -> Points, Curvature, Curvature_2
evaluate_curve = EvaluateCurve(Curve=scale.Geometry, Parameter=divide_distance.Parameters)  # -> Point, Tangent, Angle
circle_3pt = Circle3Pt(PointA=graft(list_item), PointB=graft(list_item_2), PointC=graft(list_item_3))  # -> Circle, Plane, Radius
curve_2 = Curve(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)
unit_y = UnitY(Factor=1)
end_points = EndPoints(Curve=curve_2)  # -> Start, End
cross_product = CrossProduct(VectorA=evaluate_curve.Tangent, VectorB=curvature.Curvature, Unitize=False)  # -> Vector, Length
curve_closest_point = CurveClosestPoint(Point=list_item, Curve=circle_3pt.Circle)  # -> Point, Parameter, Distance
curve_closest_point_2 = CurveClosestPoint(Point=list_item_3, Curve=circle_3pt.Circle)  # -> Point, Parameter, Distance
line_sdl = LineSDL(Start=end_points.Start, Direction=unit_y, Length=1)
unit_vector = UnitVector(Vector=cross_product.Vector)
merge = Merge(Data1=curve_closest_point.Parameter, Data2=curve_closest_point_2.Parameter)
division = Division(A=expression_3, B=2)
rotate_axis = RotateAxis(Geometry=curve_2, Angle=degrees(python_3_script_3.a), Axis=line_sdl)  # -> Geometry, Transform
shatter = Shatter(Curve=circle_3pt.Circle, Parameters=merge)
multiplication = Multiplication(A=unit_vector, B=expression_3)
unit_z = UnitZ(Factor=1)
list_item_4 = ListItem(List=shatter, Index=0, Wrap=True)
line_sdl_2 = LineSDL(Start=end_points.Start, Direction=unit_z, Length=1)
ghpython_script = GhPythonScript(x=multiplication, y=division)  # -> out, a; inputs x: list of Vector3d
# ---------- ghpython_script: Python ----------
import Rhino.Geometry as rg


'''
计算相邻的前后两个向量的距离，当距离大于阈值（2）时，后一个向量及其之后的所有向量反向
'''

def process_vectors(vector_list, threshold):
    k=1
    print(threshold)
    for i in range(1, len(vector_list)):
        distance = (vector_list[i-1] - vector_list[i]).Length
        print(distance)
        if distance > threshold:
            print(1)
            for j in range(i, len(vector_list)):
                vector_list[j].Reverse()
    return vector_list
    
a=process_vectors(x,y/2)
# ---------- end ghpython_script ----------
dispatch = Dispatch(List=flatten(list_item_4), DispatchPattern=[True, False])  # -> ListA, ListB
rotate_axis_2 = RotateAxis(Geometry=rotate_axis.Geometry, Angle=degrees(python_3_script_2.a), Axis=line_sdl_2)  # -> Geometry, Transform
move = Move(Geometry=divide_distance.Points, Motion=ghpython_script.a)  # -> Geometry, Transform
deconstruct_arc = DeconstructArc(Arc=dispatch.ListB)  # -> BasePlane, Radius, Angle
deconstruct_arc_2 = DeconstructArc(Arc=dispatch.ListA)  # -> BasePlane, Radius, Angle
midpoint = Midpoint(Curve=graft(dispatch.ListA))
midpoint_2 = Midpoint(Curve=graft(dispatch.ListB))
curve_3 = Curve(rotate_axis_2.Geometry)
line = Line(StartPoint=divide_distance.Points, EndPoint=move.Geometry)
end_points_2 = EndPoints(Curve=curve_3)  # -> Start, End
deconstruct_plane = DeconstructPlane(Plane=deconstruct_arc_2.BasePlane)  # -> Origin, XAxis, YAxis, ZAxis
deconstruct_plane_2 = DeconstructPlane(Plane=deconstruct_arc.BasePlane)  # -> Origin, XAxis, YAxis, ZAxis
dispatch_2 = Dispatch(List=line, DispatchPattern=[True, False])  # -> ListA, ListB
vector_2pt = Vector2Pt(PointA=end_points_2.Start, PointB=end_points_2.End, Unitize=False)  # -> Vector, Length
vector_2pt_2 = Vector2Pt(PointA=graft(deconstruct_plane_2.Origin), PointB=midpoint_2, Unitize=False)  # -> Vector, Length
vector_2pt_3 = Vector2Pt(PointA=graft(deconstruct_plane.Origin), PointB=midpoint, Unitize=False)  # -> Vector, Length
list_item_5 = ListItem(List=dispatch_2.ListB, Index=0, Wrap=True)
list_item_6 = ListItem(List=dispatch_2.ListA, Index=0, Wrap=True)
construct_plane = ConstructPlane(Origin=graft(deconstruct_plane.Origin), XAxis=vector_2pt_3.Vector, YAxis=graft(deconstruct_plane.ZAxis))
construct_plane_2 = ConstructPlane(Origin=graft(deconstruct_plane_2.Origin), XAxis=vector_2pt_2.Vector, YAxis=graft(deconstruct_plane_2.ZAxis))
end_points_3 = EndPoints(Curve=list_item_6)  # -> Start, End
end_points_4 = EndPoints(Curve=list_item_5)  # -> Start, End
vector_2pt_4 = Vector2Pt(PointA=end_points_3.Start, PointB=end_points_3.End, Unitize=False)  # -> Vector, Length
rotate_direction = RotateDirection(Geometry=list_item_5, Center=end_points_4.Start, From=vector_2pt_4.Vector, To=vector_2pt.Vector)  # -> Geometry, Transform
rotate_direction_2 = RotateDirection(Geometry=list_item_6, Center=end_points_3.Start, From=vector_2pt_4.Vector, To=vector_2pt.Vector)  # -> Geometry, Transform
python_3_script_7 = Python3Script(x=rotate_direction_2.Geometry, plane=flatten(construct_plane))  # -> out, swipes; inputs x: Line, plane: list of Plane
# ---------- python_3_script_7: Python ----------
import Rhino.Geometry as rg

line_mirror = x  # 输入的线
swipes = []

for i_plane in range(len(plane)):
    # 创建镜像变换
    mirror_transform = rg.Transform.Mirror(plane[i_plane])
    line_mirror.Transform(mirror_transform)
    # 使用线段的起始点和终点创建新的线段
    line_temp = rg.Line(line_mirror.From, line_mirror.To)
    
    # 添加临时线段到 swipes 列表
    swipes.append(line_temp)
    
    # 应用镜像变换到原线段
    

# 输出镜像线段的数量
print(len(swipes))
# ---------- end python_3_script_7 ----------
python_3_script_8 = Python3Script(x=rotate_direction.Geometry, plane=flatten(construct_plane_2))  # -> out, swipes; inputs x: Line, plane: list of Plane; same code as python_3_script_7
merge_2 = Merge(Data1=flatten(list_item_6), Data2=flatten(python_3_script_7.swipes))
merge_3 = Merge(Data1=flatten(list_item_5), Data2=flatten(python_3_script_8.swipes))
entwine = Entwine(Branch00=merge_2, Branch01=merge_3, FlattenInputs=True)
python_3_script_9 = Python3Script(rule=entwine)  # -> out, Rules
# ---------- python_3_script_9: Python ----------
Rules=rule
# ---------- end python_3_script_9 ----------
python_3_script_10 = Python3Script(x=cross_product.Vector)  # -> out, B_vec
# ---------- python_3_script_10: Python ----------
B_vec = x
# ---------- end python_3_script_10 ----------
python_3_script_11 = Python3Script(x=curvature.Points)  # -> out, Points
# ---------- python_3_script_11: Python ----------
Points = x
# ---------- end python_3_script_11 ----------
python_3_script_12 = Python3Script(x=evaluate_curve.Tangent)  # -> out, T_vec
# ---------- python_3_script_12: Python ----------
T_vec = x
# ---------- end python_3_script_12 ----------
rules = ClusterOutput(python_3_script_9.Rules)
t_vec = ClusterOutput(python_3_script_12.T_vec)
b_vec = ClusterOutput(python_3_script_10.B_vec)
points = ClusterOutput(python_3_script_11.Points)

# ==== cluster Flatten: Space ribbon and flattened points and ribbon generation
space_curve = ClusterInput()
rules = ClusterInput()
i = ClusterInput()
python_3_script = Python3Script(Space_Curve=space_curve)  # -> out, a
# ---------- python_3_script: Python ----------
a=Space_Curve
# ---------- end python_3_script ----------
python_3_script_2 = Python3Script(Rules=rules)  # -> out, a
# ---------- python_3_script_2: Python ----------
a=Rules
# ---------- end python_3_script_2 ----------
python_3_script_3 = Python3Script(i=i)  # -> out, a; same code as python_3_script_4
expression = Expression(i=python_3_script_3.a, Expression="2.4*i")
explode_tree = ExplodeTree(Data=python_3_script_2.a)  # -> Branch0, Branch1
end_points = EndPoints(Curve=explode_tree.Branch1)  # -> Start, End
end_points_2 = EndPoints(Curve=explode_tree.Branch0)  # -> Start, End
vector_2pt = Vector2Pt(PointA=end_points_2.Start, PointB=end_points_2.End, Unitize=False)  # -> Vector, Length
vector_2pt_2 = Vector2Pt(PointA=end_points.Start, PointB=end_points.End, Unitize=False)  # -> Vector, Length
move = Move(Geometry=end_points.Start, Motion=vector_2pt_2.Vector)  # -> Geometry, Transform
negative = Negative(Value=vector_2pt.Vector)
line = Line(StartPoint=end_points.Start, EndPoint=move.Geometry)
list_length = ListLength(List=line)
move_2 = Move(Geometry=end_points_2.Start, Motion=negative)  # -> Geometry, Transform
expression_2 = Expression(l=list_length, Expression="l-1")
construct_domain = ConstructDomain(DomainStart=1, DomainEnd=expression_2)
line_2 = Line(StartPoint=end_points_2.Start, EndPoint=move_2.Geometry)
sub_list = SubList(List=line, Domain=construct_domain, Wrap=True)  # -> List, Index
list_length_2 = ListLength(List=line_2)
end_points_3 = EndPoints(Curve=sub_list.List)  # -> Start, End
expression_3 = Expression(l=list_length_2, Expression="l-1")
construct_domain_2 = ConstructDomain(DomainStart=1, DomainEnd=expression_3)
vector_2pt_3 = Vector2Pt(PointA=end_points_3.End, PointB=end_points_3.Start, Unitize=False)  # -> Vector, Length
sub_list_2 = SubList(List=line_2, Domain=construct_domain_2, Wrap=True)  # -> List, Index
move_3 = Move(Geometry=graft(end_points_3.Start), Motion=graft(vector_2pt_3.Vector))  # -> flatten(Geometry), Transform
end_points_4 = EndPoints(Curve=sub_list_2.List)  # -> Start, End
curve_closest_point = CurveClosestPoint(Point=end_points_4.End, Curve=python_3_script.a)  # -> Point, Parameter, Distance
vector_2pt_4 = Vector2Pt(PointA=end_points_4.End, PointB=end_points_4.Start, Unitize=False)  # -> Vector, Length
nurbs_curve = NurbsCurve(Vertices=end_points_4.End, Degree=3, Periodic=False)  # -> Curve, Length, Domain
nurbs_curve_2 = NurbsCurve(Vertices=move_3.Geometry, Degree=3, Periodic=False)  # -> Curve, Length, Domain
nurbs_curve_3 = NurbsCurve(Vertices=end_points_3.End, Degree=3, Periodic=False)  # -> Curve, Length, Domain
move_4 = Move(Geometry=graft(end_points_4.Start), Motion=graft(vector_2pt_4.Vector))  # -> flatten(Geometry), Transform
vector_2pt_5 = Vector2Pt(PointA=end_points_4.End, PointB=curve_closest_point.Point, Unitize=False)  # -> Vector, Length
simplify_tree = SimplifyTree(Tree=nurbs_curve_2.Curve, Front=False)
simplify_tree_2 = SimplifyTree(Tree=nurbs_curve_3.Curve, Front=False)
nurbs_curve_4 = NurbsCurve(Vertices=move_4.Geometry, Degree=3, Periodic=False)  # -> Curve, Length, Domain
merge = Merge(Data1=simplify_tree_2, Data2=simplify_tree)  # -> flatten(Result)
merge_2 = Merge(Data1=nurbs_curve.Curve, Data2=nurbs_curve_4.Curve)  # -> flatten(Result)
loft = Loft(Curves=merge, Options={Adjust=False, Closed=False, LoftEnds=0, LoftSimp=0, LoftType=0, Rebuild=10, Refit=0.01})
loft_2 = Loft(Curves=merge_2, Options={Adjust=False, Closed=False, LoftEnds=0, LoftSimp=0, LoftType=0, Rebuild=10, Refit=0.01})
expression_4 = Expression(hz=expression, Expression="hz/2")
offset_surface = OffsetSurface(Surface=loft, Distance=expression_4, Retrim=True)
offset_surface_2 = OffsetSurface(Surface=loft_2, Distance=expression_4, Retrim=True)
flip = Flip(Surface=offset_surface)  # -> Surface, Result
end_points_5 = EndPoints(Curve=nurbs_curve_2.Curve)  # -> Start, End
surface_closest_point = SurfaceClosestPoint(Point=end_points_4.Start, Surface=offset_surface_2)  # -> Point, UVPoint, Distance
surface_closest_point_2 = SurfaceClosestPoint(Point=end_points_3.Start, Surface=flip.Surface)  # -> Point, UVPoint, Distance
unroll_brep = UnrollBrep(Brep=flip.Surface, Points=surface_closest_point_2.Point)  # -> Brep, Curves, Points
unroll_brep_2 = UnrollBrep(Brep=offset_surface_2, Points=surface_closest_point.Point)  # -> Brep, Curves, Points

nurbs_curve_5 = NurbsCurve(Vertices=unroll_brep.Points, Degree=3, Periodic=False)  # -> Curve, Length, Domain
nurbs_curve_6 = NurbsCurve(Vertices=unroll_brep_2.Points, Degree=3, Periodic=False)  # -> Curve, Length, Domain
entwine = Entwine(Branch00=nurbs_curve_6.Curve, Branch01=nurbs_curve_5.Curve, FlattenInputs=True)

entwine_2 = Entwine(Branch00=unroll_brep_2.Points, Branch01=unroll_brep.Points, FlattenInputs=True)
entwine_3 = Entwine(Branch00=offset_surface, Branch01=offset_surface_2, FlattenInputs=True)
python_3_script_4 = Python3Script(x=entwine_3)  # -> out, simplify(Space_Ribbon)
# ---------- python_3_script_4: Python ----------
Space_Ribbon=x
# ---------- end python_3_script_4 ----------
python_3_script_5 = Python3Script(x=entwine_2)  # -> out, Flattened_Points
# ---------- python_3_script_5: Python ----------
Flattened_Points=x
# ---------- end python_3_script_5 ----------
python_3_script_6 = Python3Script(x=entwine)  # -> out, Flattened_Curve
# ---------- python_3_script_6: Python ----------
Flattened_Curve=x
# ---------- end python_3_script_6 ----------
space_ribbon = ClusterOutput(python_3_script_4.Space_Ribbon)
flattened_points = ClusterOutput(python_3_script_5.Flattened_Points)
flattened_curve = ClusterOutput(python_3_script_6.Flattened_Curve)

# ==== cluster RawUnit: Generate raw unit without features
planar_curve = ClusterInput()
points_curve = ClusterInput()
loft_angle = ClusterInput()
i = ClusterInput()
python_3_script = Python3Script(Planar_curve=planar_curve)  # -> out, a
# ---------- python_3_script: Python ----------
a=Planar_curve
# ---------- end python_3_script ----------
python_3_script_2 = Python3Script(Points_curve=points_curve)  # -> out, a
# ---------- python_3_script_2: Python ----------
a=Points_curve
# ---------- end python_3_script_2 ----------
python_3_script_3 = Python3Script(Loft_Angle=loft_angle)  # -> out, a
# ---------- python_3_script_3: Python ----------
a=Loft_Angle
# ---------- end python_3_script_3 ----------
python_3_script_4 = Python3Script(i=i)  # -> out, a; same code as python_3_script_4
expression = Expression(i=python_3_script_4.a, Expression="1.6*i")
expression_2 = Expression(i=python_3_script_4.a, Expression="2.4*i")
expression_3 = Expression(i=python_3_script_4.a, Expression="4.8*i")
explode_tree = ExplodeTree(Data=python_3_script_2.a)  # -> Branch0, Branch1
geometry = Geometry(explode_tree.Branch0)
geometry_2 = Geometry(explode_tree.Branch1)
list_length = ListLength(List=geometry)
list_length_2 = ListLength(List=geometry_2)
expression_4 = Expression(x=list_length_2, Expression="x-2")
expression_5 = Expression(x=list_length, Expression="x-2")
construct_domain = ConstructDomain(DomainStart=0, DomainEnd=expression_5)
construct_domain_2 = ConstructDomain(DomainStart=0, DomainEnd=expression_4)
range = Range(Domain=construct_domain_2, Steps=expression_4)
range_2 = Range(Domain=construct_domain, Steps=expression_5)
list_item = ListItem(List=geometry_2, Index=range, Wrap=True)  # -> Item, Item1
list_item_2 = ListItem(List=geometry, Index=range_2, Wrap=True)  # -> Item, Item1
distance = Distance(PointA=list_item_2.Item, PointB=list_item_2.Item1)
distance_2 = Distance(PointA=list_item.Item, PointB=list_item.Item1)
list_length_3 = ListLength(List=distance_2)
list_length_4 = ListLength(List=distance)
expression_6 = Expression(x=list_length_4, Expression="x-2")
expression_7 = Expression(x=list_length_3, Expression="x-2")
construct_domain_3 = ConstructDomain(DomainStart=0, DomainEnd=expression_7)
construct_domain_4 = ConstructDomain(DomainStart=0, DomainEnd=expression_6)
range_3 = Range(Domain=construct_domain_4, Steps=expression_6)
range_4 = Range(Domain=construct_domain_3, Steps=expression_7)
curve_closest_point = CurveClosestPoint(Point=python_3_script_2.a, Curve=python_3_script.a)  # -> Point, Parameter, Distance
list_item_3 = ListItem(List=distance, Index=range_3, Wrap=True)  # -> Item, Item1
list_item_4 = ListItem(List=distance_2, Index=range_4, Wrap=True)  # -> Item, Item1
curvature = Curvature(Curve=python_3_script.a, Parameter=curve_closest_point.Parameter)  # -> Point, Curvature, Curvature_2
list_length_5 = ListLength(List=list_item_3.Item1)
vector_length = VectorLength(Vector=curvature.Curvature)
deconstruct_arc = DeconstructArc(Arc=curvature.Curvature_2)  # -> BasePlane, Radius, Angle
unit_vector = UnitVector(Vector=curvature.Curvature)
expression_8 = Expression(x=list_length_5, Expression="x-2")
expression_9 = Expression(x=list_item_3.Item, y=list_item_3.Item1, z=distance_2, hz=expression_2, Expression="Atan(((x+y)/2-z)/2/hz)")
construct_domain_5 = ConstructDomain(DomainStart=0, DomainEnd=expression_8)
expression_10 = Expression(x=vector_length, y=deconstruct_arc.Radius, Expression="If(x>1e-3, y, -1)")
expression_11 = Expression(wx=expression_3, Expression="wx/2")
range_5 = Range(Domain=construct_domain_5, Steps=expression_8)
multiplication = Multiplication(A=unit_vector, B=expression_11)
list_item_5 = ListItem(List=list_item_3.Item1, Index=range_5, Wrap=True)
expression_12 = Expression(R=expression_10, r=expression, wx=expression_3, Expression="If(R_<0, r, r*(R_-wx/2)/R_ )")
expression_13 = Expression(R=expression_10, r=expression, wx=expression_3, Expression="If(R_<0, r, r*(R_+wx/2)/R_)")
expression_14 = Expression(x=list_item_4.Item, y=list_item_4.Item1, z=list_item_5, hz=expression_2, Expression="Atan(((x+y)/2-z)/2/hz)")
number_slider = Slider(0, range=0..100)
negative = Negative(Value=multiplication)
merge = Merge(Data1=0, Data2=-1)
move = Move(Geometry=graft(curvature.Point), Motion=graft(multiplication))  # -> Geometry, Transform
move_2 = Move(Geometry=graft(curvature.Point), Motion=graft(negative))  # -> Geometry, Transform
multiplication_2 = Multiplication(A=unit_vector, B=expression_12)
multiplication_3 = Multiplication(A=unit_vector, B=expression_13)
negative_2 = Negative(Value=multiplication_3)
insert_items = InsertItems(List=expression_9, Item=number_slider, Indices=merge, Wrap=True)
insert_items_2 = InsertItems(List=expression_14, Item=number_slider, Indices=merge, Wrap=True)
move_3 = Move(Geometry=move.Geometry, Motion=graft(multiplication_2))  # -> Geometry, Transform
circle = Circle(Plane=move.Geometry, Radius=graft(expression_12))
circle_2 = Circle(Plane=move_2.Geometry, Radius=graft(expression_13))
move_4 = Move(Geometry=move_2.Geometry, Motion=graft(negative_2))  # -> Geometry, Transform
entwine = Entwine(Branch00=insert_items_2, Branch01=insert_items, FlattenInputs=True)
degrees = Degrees(Radians=entwine)
tangent_lines_ex = TangentLinesEx(CircleA=circle, CircleB=circle_2)  # -> Tangent1, Tangent2
end_points = EndPoints(Curve=tangent_lines_ex.Tangent1)  # -> Start, End
end_points_2 = EndPoints(Curve=tangent_lines_ex.Tangent2)  # -> Start, End
addition = Addition(A=python_3_script_3.a, B=graft(degrees))
arc_3pt = Arc3Pt(PointA=end_points.Start, PointB=move_3.Geometry, PointC=end_points_2.Start)  # -> Arc, Plane, Radius
arc_3pt_2 = Arc3Pt(PointA=end_points.End, PointB=move_4.Geometry, PointC=end_points_2.End)  # -> Arc, Plane, Radius
tangent = Tangent(Value=degrees(addition))
division = Division(A=expression_2, B=2)
merge_2 = Merge(Data1=arc_3pt.Arc, Data2=tangent_lines_ex.Tangent1, Data3=arc_3pt_2.Arc, Data4=tangent_lines_ex.Tangent2)
multiplication_4 = Multiplication(A=tangent, B=division)
join_curves = JoinCurves(Curves=merge_2, Preserve=False)
negative_3 = Negative(Value=multiplication_4)
offset_curve = OffsetCurve(Curve=join_curves, Distance=multiplication_4, Corners=1)
offset_curve_2 = OffsetCurve(Curve=join_curves, Distance=negative_3, Corners=1)
unit_z = UnitZ(Factor=expression_2)
move_5 = Move(Geometry=offset_curve, Motion=unit_z)  # -> Geometry, Transform
merge_3 = Merge(Data1=move_5.Geometry, Data2=offset_curve_2)
loft = Loft(Curves=merge_3, Options={Adjust=False, Closed=False, LoftEnds=0, LoftSimp=0, LoftType=0, Rebuild=10, Refit=0.01})
cap_holes = CapHoles(Brep=loft)
python_3_script_5 = Python3Script(x=cap_holes)  # -> out, Unit
# ---------- python_3_script_5: Python ----------
Unit=x
# ---------- end python_3_script_5 ----------
unit = ClusterOutput(python_3_script_5.Unit)

# ==== cluster BaseCut: Generate base cut with multiplier, points and xy input
planar_curve = ClusterInput()
base_cut_x = ClusterInput()
base_cut_y = ClusterInput()
i = ClusterInput()
flattened_points = ClusterInput()
python_3_script = Python3Script(Planar_Curve=planar_curve)  # -> out, a
# ---------- python_3_script: Python ----------
a=Planar_Curve
# ---------- end python_3_script ----------
python_3_script_2 = Python3Script(Base_Cut_X=base_cut_x)  # -> out, a
# ---------- python_3_script_2: Python ----------
a=Base_Cut_X
# ---------- end python_3_script_2 ----------
python_3_script_3 = Python3Script(Base_Cut_Y=base_cut_y)  # -> out, a
# ---------- python_3_script_3: Python ----------
a=Base_Cut_Y
# ---------- end python_3_script_3 ----------
python_3_script_4 = Python3Script(i=i)  # -> out, a; same code as python_3_script_4
python_3_script_5 = Python3Script(Flattened_Points=flattened_points)  # -> out, a
# ---------- python_3_script_5: Python ----------
a=Flattened_Points
# ---------- end python_3_script_5 ----------
expression = Expression(i=python_3_script_4.a, Expression="2*(0.2*i+0.2)")
expression_2 = Expression(i=python_3_script_4.a, Expression="1.6*i")
expression_3 = Expression(i=python_3_script_4.a, Expression="4.8*i")
list_length = ListLength(List=python_3_script_5.a)
expression_4 = Expression(l=list_length, Expression="l-2")
expression_5 = Expression(l=list_length, Expression="l-1")
brep = Brep(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)
construct_domain = ConstructDomain(DomainStart=1, DomainEnd=expression_5)
construct_domain_2 = ConstructDomain(DomainStart=0, DomainEnd=expression_4)
xy_plane = XYPlane(Origin=Point(0, 0, 0))
mirror = Mirror(Geometry=brep, Plane=xy_plane)  # -> Geometry, Transform
sub_list = SubList(List=python_3_script_5.a, Domain=construct_domain_2, Wrap=True)  # -> List, Index
sub_list_2 = SubList(List=python_3_script_5.a, Domain=construct_domain, Wrap=True)  # -> List, Index
volume = Volume(Geometry=mirror.Geometry)  # -> Volume, Centroid
line = Line(StartPoint=sub_list.List, EndPoint=sub_list_2.List)
project = Project(Geometry=volume.Centroid, Plane=PlaneXY(0, 0, 0))  # -> Geometry, Transform
midpoint = Midpoint(Curve=line)
line_2 = Line(StartPoint=volume.Centroid, EndPoint=project.Geometry)
curve_closest_point = CurveClosestPoint(Point=midpoint, Curve=python_3_script.a)  # -> Point, Parameter, Distance
midpoint_2 = Midpoint(Curve=line_2)
scale_nu = ScaleNU(Geometry=mirror.Geometry, Plane=midpoint_2, ScaleX=python_3_script_2.a, ScaleY=python_3_script_3.a, ScaleZ=expression)  # -> Geometry, Transform
curvature = Curvature(Curve=python_3_script.a, Parameter=curve_closest_point.Parameter)  # -> Point, Curvature, Curvature_2
volume_2 = Volume(Geometry=scale_nu.Geometry)  # -> Volume, Centroid
project_2 = Project(Geometry=volume_2.Centroid, Plane=PlaneXY(0, 0, 0))  # -> Geometry, Transform
vector_2pt = Vector2Pt(PointA=project_2.Geometry, PointB=curve_closest_point.Point, Unitize=False)  # -> Vector, Length
expression_6 = Expression(wx=expression_3, r_main=expression_2, base_cut_y=python_3_script_2.a, Expression="wx/2+r_main-base_cut_y/2+0.15*2")
move = Move(Geometry=scale_nu.Geometry, Motion=vector_2pt.Vector)  # -> Geometry, Transform
volume_3 = Volume(Geometry=move.Geometry)  # -> Volume, Centroid
unit_x = UnitX(Factor=1)
unit_vector = UnitVector(Vector=curvature.Curvature)
rotate_direction = RotateDirection(Geometry=move.Geometry, Center=volume_3.Centroid, From=unit_x, To=curvature.Curvature)  # -> Geometry, Transform
multiplication = Multiplication(A=unit_vector, B=expression_6)
negative = Negative(Value=multiplication)
move_2 = Move(Geometry=rotate_direction.Geometry, Motion=negative)  # -> Geometry, Transform
move_3 = Move(Geometry=rotate_direction.Geometry, Motion=multiplication)  # -> Geometry, Transform
unit_z = UnitZ(Factor=0.3)
merge = Merge(Data1=move_3.Geometry, Data2=move_2.Geometry)
move_4 = Move(Geometry=merge, Motion=unit_z)  # -> Geometry, Transform
simplify_tree = SimplifyTree(Tree=move_4.Geometry, Front=False)
cap_holes = CapHoles(Brep=simplify_tree)
python_3_script_6 = Python3Script(x=cap_holes)  # -> out, Base_Cut
# ---------- python_3_script_6: Python ----------
Base_Cut = x
# ---------- end python_3_script_6 ----------
base_cut = ClusterOutput(python_3_script_6.Base_Cut)

# ==== cluster Ribbon: Generate Ribbon with height
planar_curve = ClusterInput()
width = ClusterInput()
height = ClusterInput()
i = ClusterInput()
python_3_script = Python3Script(Planar_curve=planar_curve)  # -> out, a; same code as python_3_script
python_3_script_2 = Python3Script(Width=width)  # -> out, a
# ---------- python_3_script_2: Python ----------
a=Width
# ---------- end python_3_script_2 ----------
python_3_script_3 = Python3Script(Height=height)  # -> out, a
# ---------- python_3_script_3: Python ----------
a=Height
# ---------- end python_3_script_3 ----------
python_3_script_4 = Python3Script(i=i)  # -> out, a; same code as python_3_script_4
end_points = EndPoints(Curve=python_3_script.a)  # -> Start, End
end_points_2 = EndPoints(Curve=python_3_script.a)  # -> Start, End
curve_closest_point = CurveClosestPoint(Point=end_points.Start, Curve=python_3_script.a)  # -> Point, Parameter, Distance
curve_closest_point_2 = CurveClosestPoint(Point=end_points_2.End, Curve=python_3_script.a)  # -> Point, Parameter, Distance
merge = Merge(Data1=curve_closest_point.Parameter, Data2=curve_closest_point_2.Parameter)
evaluate_curve = EvaluateCurve(Curve=python_3_script.a, Parameter=merge)  # -> Point, Tangent, Angle
expression = Expression(i=python_3_script_4.a, Expression="1.6*i")
unit_vector = UnitVector(Vector=evaluate_curve.Tangent)
panel = Panel("""-1
1""")
multiplication = Multiplication(A=unit_vector, B=expression)
multiplication_2 = Multiplication(A=multiplication, B=panel)
move = Move(Geometry=evaluate_curve.Point, Motion=multiplication_2)  # -> Geometry, Transform
line = Line(StartPoint=move.Geometry, EndPoint=evaluate_curve.Point)
merge_2 = Merge(Data1=python_3_script.a, Data2=line)
join_curves = JoinCurves(Curves=merge_2, Preserve=False)
negative = Negative(Value=python_3_script_2.a)
offset_curve = OffsetCurve(Curve=join_curves, Distance=python_3_script_2.a, Corners=1)
offset_curve_2 = OffsetCurve(Curve=join_curves, Distance=negative, Corners=1)
end_points_3 = EndPoints(Curve=offset_curve)  # -> Start, End
end_points_4 = EndPoints(Curve=offset_curve_2)  # -> Start, End
line_2 = Line(StartPoint=end_points_3.Start, EndPoint=end_points_4.Start)
line_3 = Line(StartPoint=end_points_3.End, EndPoint=end_points_4.End)
merge_3 = Merge(Data1=offset_curve, Data2=line_2, Data3=offset_curve_2, Data4=line_3)
join_curves_2 = JoinCurves(Curves=merge_3, Preserve=False)
unit_z = UnitZ(Factor=python_3_script_3.a)
extrude = Extrude(Base=join_curves_2, Direction=unit_z)
cap_holes = CapHoles(Brep=extrude)
python_3_script_5 = Python3Script(y=cap_holes)  # -> out, Ribbon
# ---------- python_3_script_5: Python ----------
Ribbon=y
# ---------- end python_3_script_5 ----------
ribbon = ClusterOutput(python_3_script_5.Ribbon)

# ==== cluster UnitCut: Generate unit cut for easier engagement
flattened_points = ClusterInput()
planar_curve = ClusterInput()
i = ClusterInput()
python_3_script = Python3Script(Flattened_Points=flattened_points)  # -> out, a; same code as python_3_script_5
python_3_script_2 = Python3Script(Planar_Curve=planar_curve)  # -> out, a; same code as python_3_script
python_3_script_3 = Python3Script(i=i)  # -> out, a; same code as python_3_script_4
expression = Expression(i=python_3_script_3.a, Expression="If(i<0.75, 0, 1.2*i)")
expression_2 = Expression(i=python_3_script_3.a, Expression="0.6*i")
expression_3 = Expression(i=python_3_script_3.a, Expression="9*i")
brep = Brep(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)
scale_nu = ScaleNU(Geometry=brep, Plane=PlaneXY(0, 0, 0), ScaleX=expression_3, ScaleY=expression_2, ScaleZ=expression)  # -> Geometry, Transform
volume = Volume(Geometry=scale_nu.Geometry)  # -> Volume, Centroid
expression_4 = Expression(i=python_3_script_3.a, Expression="2.4*i")
project = Project(Geometry=volume.Centroid, Plane=PlaneXY(0, 0, 0))  # -> Geometry, Transform
curve_closest_point = CurveClosestPoint(Point=python_3_script.a, Curve=python_3_script_2.a)  # -> Point, Parameter, Distance
expression_5 = Expression(hz=expression_4, unit_cut_z=expression, Expression="hz-unit_cut_z")
vector_2pt = Vector2Pt(PointA=project.Geometry, PointB=python_3_script.a, Unitize=False)  # -> Vector, Length
curvature = Curvature(Curve=python_3_script_2.a, Parameter=curve_closest_point.Parameter)  # -> Point, Curvature, Curvature_2
move = Move(Geometry=scale_nu.Geometry, Motion=vector_2pt.Vector)  # -> Geometry, Transform
unit_z = UnitZ(Factor=expression_5)
unit_x = UnitX(Factor=1)
move_2 = Move(Geometry=move.Geometry, Motion=unit_z)  # -> Geometry, Transform
volume_2 = Volume(Geometry=move_2.Geometry)  # -> Volume, Centroid
rotate_direction = RotateDirection(Geometry=move_2.Geometry, Center=volume_2.Centroid, From=unit_x, To=curvature.Curvature)  # -> Geometry, Transform
python_3_script_4 = Python3Script(x=rotate_direction.Geometry)  # -> out, Unit_Cut
# ---------- python_3_script_4: Python ----------
Unit_Cut=x
# ---------- end python_3_script_4 ----------
unit_cut = ClusterOutput(python_3_script_4.Unit_Cut)

# ==== cluster FeaturedUnit: Generate unit with unit cut and splint cut
splint_cut = ClusterInput()
unit_cut = ClusterInput()
unit = ClusterInput()
i = ClusterInput()
python_3_script = Python3Script(Splint_Cut=splint_cut)  # -> out, a
# ---------- python_3_script: Python ----------
a=Splint_Cut
# ---------- end python_3_script ----------
python_3_script_2 = Python3Script(Unit_Cut=unit_cut)  # -> out, a
# ---------- python_3_script_2: Python ----------
a=Unit_Cut
# ---------- end python_3_script_2 ----------
python_3_script_3 = Python3Script(Unit=unit)  # -> out, a
# ---------- python_3_script_3: Python ----------
a=Unit
# ---------- end python_3_script_3 ----------
python_3_script_4 = Python3Script(i=i)  # -> out, a; same code as python_3_script_4
expression = Expression(i=python_3_script_4.a, Expression="0.4*i+0.2")
expression_2 = Expression(i=python_3_script_4.a, Expression="2.4*i")
expression_3 = Expression(hz=expression_2, splint_z=expression, Expression="hz-splint_z")
expression_4 = Expression(i=python_3_script_4.a, Expression="0.5*i")
unit_z = UnitZ(Factor=expression_3)
move = Move(Geometry=python_3_script.a, Motion=unit_z)  # -> Geometry, Transform
unit_z_2 = UnitZ(Factor=Slider(0.02, range=0..0.1))
fillet_edge = FilletEdge(Shape=python_3_script_3.a, Blend=1, Metric=0, Edges=2, Radii=expression_4)
move_2 = Move(Geometry=move.Geometry, Motion=unit_z_2)  # -> Geometry, Transform
simplify_tree = SimplifyTree(Tree=python_3_script_2.a, Front=False)
simplify_tree_2 = SimplifyTree(Tree=fillet_edge, Front=False)
volume = Volume(Geometry=simplify_tree)  # -> Volume, Centroid
volume_2 = Volume(Geometry=fillet_edge)  # -> Volume, Centroid
simplify_tree_3 = SimplifyTree(Tree=move_2.Geometry, Front=False)
trim_tree = TrimTree(Tree=simplify_tree_2, Depth=1)
project = Project(Geometry=volume.Centroid, Plane=PlaneXY(0, 0, 0))  # -> Geometry, Transform
project_2 = Project(Geometry=volume_2.Centroid, Plane=PlaneXY(0, 0, 0))  # -> Geometry, Transform
unit_z_3 = UnitZ(Factor=Slider(0.02, range=0..0.1))
solid_difference = SolidDifference(BrepsA=trim_tree, BrepsB=simplify_tree_3)
vector_2pt = Vector2Pt(PointA=graft(project.Geometry), PointB=project_2.Geometry, Unitize=False)  # -> Vector, Length
move_3 = Move(Geometry=simplify_tree, Motion=unit_z_3)  # -> Geometry, Transform
simplify_tree_4 = SimplifyTree(Tree=vector_2pt.Vector, Front=False)
explode_tree = ExplodeTree(Data=solid_difference)  # -> Branch0, Branch1
explode_tree_2 = ExplodeTree(Data=move_3.Geometry)  # -> Branch0, Branch1
move_4 = Move(Geometry=graft(simplify_tree), Motion=simplify_tree_4)  # -> Geometry, Transform

# ----
# 完整feature单元
solid_difference_2 = SolidDifference(BrepsA=graft(solid_difference), BrepsB=move_4.Geometry)
move_5 = Move(Geometry=solid_difference_2, Motion=unit_z_3)  # -> Geometry, Transform

geometry = Geometry(explode_tree.Branch0)
geometry_2 = Geometry(explode_tree_2.Branch0)
python_3_script_5 = Python3Script(x=move_5.Geometry)  # -> out, reverse(Featured_Unit)
# ---------- python_3_script_5: Python ----------
Featured_Unit = x
# ---------- end python_3_script_5 ----------
featured_unit = ClusterOutput(python_3_script_5.Featured_Unit)

# ==== cluster Zipper_Rearrange: Auto rearrange zipper for a intersection free layout.
geo = ClusterInput()
python_3_script = Python3Script(Geo=geo)  # -> out, a
# ---------- python_3_script: Python ----------
a=Geo
# ---------- end python_3_script ----------
list_item = ListItem(List=flatten(python_3_script.a), Index=0, Wrap=True)  # -> Item, Item1
xy_plane = XYPlane(Origin=Point(0, 0, 0))
mirror_surface = MirrorSurface(Geometry=list_item.Item, Surface=xy_plane, Frame=True)
merge = Merge(Data1=mirror_surface, Data2=list_item.Item1)
box = Box(merge)
list_item_2 = ListItem(List=box, Index=0, Wrap=True)
deconstruct_box = DeconstructBox(Box=box)  # -> Plane, X, Y, Z
deconstruct_domain = DeconstructDomain(Domain=deconstruct_box.X)  # -> Start, End
list_item_3 = ListItem(List=deconstruct_domain.End, Index=0, Wrap=True)  # -> Item, Item1
list_item_4 = ListItem(List=deconstruct_domain.Start, Index=0, Wrap=True)
expression = Expression(x=list_item_3.Item1, y=list_item_4, Expression="x-y")
unit_x = UnitX(Factor=expression)
list_item_5 = ListItem(List=merge, Index=0, Wrap=True)
move = Move(Geometry=list_item_5, Motion=unit_x)  # -> Geometry, Transform
volume = Volume(Geometry=move.Geometry)  # -> Volume, Centroid
xz_plane = XZPlane(Origin=volume.Centroid)
rotate = Rotate(Geometry=move.Geometry, Angle=degrees(Slider(180, range=0..1000)), Plane=xz_plane)  # -> Geometry, Transform
merge_2 = Merge(Data1=rotate.Geometry, Data2=list_item.Item1)
geometry = Geometry(merge_2)
python_3_script_2 = Python3Script(x=geometry)  # -> out, Re_arranged_Zipper
# ---------- python_3_script_2: Python ----------
Re_arranged_Zipper = x
# ---------- end python_3_script_2 ----------
re_arranged_zipper = ClusterOutput(python_3_script_2.Re_arranged_Zipper)
